# Grasshopper definition wkt.gh (Grasshopper 1.0.8)

slab_edge = Curve(<curve referenced from the Rhino model>)
slab_openings = Curve([<curve referenced from the Rhino model> x2])
walls = Curve([<curve referenced from the Rhino model> x2])
columns = Curve([<curve referenced from the Rhino model> x17])
curve = Curve(<curve referenced from the Rhino model>)
curve_2 = Curve(<curve referenced from the Rhino model>)
control_points = ControlPoints(Curve=curve)  # -> Points, Weights, Knots
control_points_2 = ControlPoints(Curve=curve_2)  # -> Points, Weights, Knots
control_points_3 = ControlPoints(Curve=walls)  # -> Points, Weights, Knots
control_points_4 = ControlPoints(Curve=columns)  # -> Points, Weights, Knots
deconstruct = Deconstruct(Point=control_points.Points)  # -> XComponent, YComponent, ZComponent
deconstruct_2 = Deconstruct(Point=control_points_2.Points)  # -> XComponent, YComponent, ZComponent
control_points_5 = ControlPoints(Curve=slab_edge)  # -> Points, Weights, Knots
control_points_6 = ControlPoints(Curve=slab_openings)  # -> Points, Weights, Knots
deconstruct_3 = Deconstruct(Point=control_points_4.Points)  # -> XComponent, YComponent, ZComponent
expression = Expression(x=deconstruct.XComponent, y=deconstruct.YComponent, Expression="Format(\"{0} {1}\", round(x,3), round(y,3))")
expression_2 = Expression(x=deconstruct_2.XComponent, y=deconstruct_2.YComponent, Expression="Format(\"{0} {1}\", round(x,3), round(y,3))")
deconstruct_4 = Deconstruct(Point=control_points_3.Points)  # -> XComponent, YComponent, ZComponent
deconstruct_5 = Deconstruct(Point=control_points_6.Points)  # -> XComponent, YComponent, ZComponent
deconstruct_6 = Deconstruct(Point=control_points_5.Points)  # -> XComponent, YComponent, ZComponent
expression_3 = Expression(x=deconstruct_3.XComponent, y=deconstruct_3.YComponent, Expression="Format(\"{0} {1}\", round(x,3), round(y,3))")
expression_4 = Expression(x=deconstruct_4.XComponent, y=deconstruct_4.YComponent, Expression="Format(\"{0} {1}\", round(x,3), round(y,3))")
expression_5 = Expression(x=deconstruct_5.XComponent, y=deconstruct_5.YComponent, Expression="Format(\"{0} {1}\", round(x,3), round(y,3))")
expression_6 = Expression(x=deconstruct_6.XComponent, y=deconstruct_6.YComponent, Expression="Format(\"{0} {1}\", round(x,3), round(y,3))")
text_join = TextJoin(Text=expression, Join=",")
text_join_2 = TextJoin(Text=expression_2, Join=",")
panel = Panel(text_join)
panel_2 = Panel(text_join_2)
columns_2 = Panel(expression_3)
slab_openings_2 = Panel(expression_5)
walls_2 = Panel(expression_4)
slab_edge_2 = Panel(expression_6)
text_join_3 = TextJoin(Text=expression_3, Join=",")
text_join_4 = TextJoin(Text=expression_4, Join=",")
text_join_5 = TextJoin(Text=expression_5, Join=",")
panel_3 = Panel(text_join_3)
text_join_6 = TextJoin(Text=expression_6, Join=",")
panel_4 = Panel(text_join_4)
panel_5 = Panel(text_join_5)
concatenate = Concatenate(Fragment_A="((", Fragment_B=text_join_5, Fragment_C="))")  # -> flatten(Result)
concatenate_2 = Concatenate(Fragment_A="((", Fragment_B=text_join_4, Fragment_C="))")  # -> flatten(Result)
concatenate_3 = Concatenate(Fragment_A="((", Fragment_B=text_join_3, Fragment_C="))")  # -> flatten(Result)
text_join_7 = TextJoin(Text=concatenate, Join=",")
text_join_8 = TextJoin(Text=concatenate_2, Join=",")
text_join_9 = TextJoin(Text=concatenate_3, Join=",")
panel_6 = Panel(text_join_6)
panel_7 = Panel(text_join_7)
panel_8 = Panel(text_join_8)
panel_9 = Panel(text_join_9)
