# Grasshopper definition wkt_r01.gh (Grasshopper 1.0.8)
# plug-ins: RhinoCodePluginGH

slab_edge = Curve(<curve referenced from the Rhino model>)
slab_openings = Curve([<curve referenced from the Rhino model> x2])
walls = Curve([<curve referenced from the Rhino model> x2])
columns = Curve([<curve referenced from the Rhino model> x17])
occupancy_a = Curve(<curve referenced from the Rhino model>)
occupancy_b = Curve(<curve referenced from the Rhino model>)
slab_edge_2 = Curve(<curve referenced from the Rhino model>)
occupancy_a_2 = Curve(<curve referenced from the Rhino model>)
occupancy_b_2 = Curve(<curve referenced from the Rhino model>)
slab_openings_2 = Curve([<curve referenced from the Rhino model> x2])
walls_2 = Curve([<curve referenced from the Rhino model> x2])
columns_2 = Curve([<curve referenced from the Rhino model> x17])
control_points = ControlPoints(Curve=occupancy_a)  # -> Points, Weights, Knots
control_points_2 = ControlPoints(Curve=occupancy_b)  # -> Points, Weights, Knots
control_points_3 = ControlPoints(Curve=walls_2)  # -> Points, Weights, Knots
slab_edge_3 = Curve(<curve referenced from the Rhino model>)
slab_openings_3 = Curve([<curve referenced from the Rhino model> x2])
occupancy_a_3 = Curve(<curve referenced from the Rhino model>)
occupancy_b_3 = Curve(<curve referenced from the Rhino model>)
walls_3 = Curve([<curve referenced from the Rhino model> x2])
columns_3 = Curve([<curve referenced from the Rhino model> x17])
control_points_4 = ControlPoints(Curve=walls)  # -> Points, Weights, Knots
control_points_5 = ControlPoints(Curve=columns)  # -> Points, Weights, Knots
deconstruct = Deconstruct(Point=control_points.Points)  # -> XComponent, YComponent, ZComponent
deconstruct_2 = Deconstruct(Point=control_points_2.Points)  # -> XComponent, YComponent, ZComponent
multipolygon = Python3Script(curves=slab_openings_2)  # -> out, polygons, multiploygon; inputs curves: list of Curve
# ---------- multipolygon: Python ----------
import shapely as shp
import numpy as np
import rhinoscriptsyntax as rs

ROUNDING = 4
polygons = []

for curve in curves:
    points = rs.CurvePoints(curve)
    coords = []
    for pnt in points:
        pnt_coord = (round(pnt.X,ROUNDING), round(pnt.Y,ROUNDING))
        if pnt_coord not in coords:
            coords.append(pnt_coord)
    polygons.append(shp.Polygon(coords))

multiploygon = shp.MultiPolygon(polygons)
# ---------- end multipolygon ----------
polygon = Python3Script(curve=slab_openings_2)  # -> out, polygon; inputs curve: Curve
# ---------- polygon: Python ----------
import shapely as shp
import numpy as np
import rhinoscriptsyntax as rs

ROUNDING= 4

points = rs.CurvePoints(curve)
coords = []
for pnt in points:
    pnt_coord = (round(pnt.X,ROUNDING), round(pnt.Y,ROUNDING))
    if pnt_coord not in coords:
        coords.append(pnt_coord)
polygon = shp.Polygon(coords)
# ---------- end polygon ----------
control_points_6 = ControlPoints(Curve=slab_edge)  # -> Points, Weights, Knots
control_points_7 = ControlPoints(Curve=slab_openings)  # -> Points, Weights, Knots
cull_duplicates = CullDuplicates(Points=control_points_3.Points, Tolerance=0.1, CullMode=3)  # -> Points, Indices, Valence
control_points_8 = ControlPoints(Curve=slab_edge_3)  # -> Points, Weights, Knots
control_points_9 = ControlPoints(Curve=slab_openings_3)  # -> Points, Weights, Knots
control_points_10 = ControlPoints(Curve=occupancy_a_3)  # -> Points, Weights, Knots
control_points_11 = ControlPoints(Curve=occupancy_b_3)  # -> Points, Weights, Knots
control_points_12 = ControlPoints(Curve=walls_3)  # -> Points, Weights, Knots
control_points_13 = ControlPoints(Curve=columns_3)  # -> Points, Weights, Knots
deconstruct_3 = Deconstruct(Point=control_points_5.Points)  # -> XComponent, YComponent, ZComponent
expression = Expression(x=deconstruct.XComponent, y=deconstruct.YComponent, Expression="Format(\"{0} {1}\", round(x,3), round(y,3))")
expression_2 = Expression(x=deconstruct_2.XComponent, y=deconstruct_2.YComponent, Expression="Format(\"{0} {1}\", round(x,3), round(y,3))")
deconstruct_4 = Deconstruct(Point=control_points_4.Points)  # -> XComponent, YComponent, ZComponent
deconstruct_5 = Deconstruct(Point=control_points_7.Points)  # -> XComponent, YComponent, ZComponent
polygon_2 = Python3Script(points=cull_duplicates.Points)  # -> out, polygon; inputs points: list of Point3d
# ---------- polygon_2: Python ----------
import shapely as shp

ROUNDING= 4

coords=[]
for pnt in points:
    pnt_coord = (round(pnt.X,ROUNDING), round(pnt.Y,ROUNDING))
    coords.append(pnt_coord)
polygon = shp.Polygon(coords)
# ---------- end polygon_2 ----------
cull_duplicates_2 = CullDuplicates(Points=control_points_8.Points, Tolerance=0.1, CullMode=1)  # -> Points, Indices, Valence
cull_duplicates_3 = CullDuplicates(Points=control_points_9.Points, Tolerance=0.1, CullMode=1)  # -> Points, Indices, Valence
cull_duplicates_4 = CullDuplicates(Points=control_points_10.Points, Tolerance=0.1, CullMode=1)  # -> Points, Indices, Valence
cull_duplicates_5 = CullDuplicates(Points=control_points_11.Points, Tolerance=0.1, CullMode=1)  # -> Points, Indices, Valence
cull_duplicates_6 = CullDuplicates(Points=control_points_12.Points, Tolerance=0.1, CullMode=1)  # -> Points, Indices, Valence
cull_duplicates_7 = CullDuplicates(Points=control_points_13.Points, Tolerance=0.1, CullMode=1)  # -> Points, Indices, Valence
panel = Panel(polygon.polygon)
deconstruct_6 = Deconstruct(Point=control_points_6.Points)  # -> XComponent, YComponent, ZComponent
polygon_3 = Python3Script(polygons=flatten(polygon_2.polygon))  # -> out, multipolygon, polygons; inputs polygons: list
# ---------- polygon_3: Python ----------
import shapely as shp

multipolygon = shp.MultiPolygon(polygons)
# ---------- end polygon_3 ----------
expression_3 = Expression(x=deconstruct_3.XComponent, y=deconstruct_3.YComponent, Expression="Format(\"{0} {1}\", round(x,3), round(y,3))")
panel_2 = Panel(multipolygon.multiploygon)
python_3_script = Python3Script()  # -> out, a, pnts
# ---------- python_3_script: Python ----------
"""Grasshopper Script"""
import rhinoscriptsyntax as rs
import ghpythonlib.treehelpers as th

total_pnts = []

pnts = []
pnts.append(rs.AddPoint(0,0,0))
pnts.append(rs.AddPoint(5000,5000,0))
total_pnts.append(pnts)

pnts = []
pnts.append(rs.AddPoint(0,5000,0))
pnts.append(rs.AddPoint(5000,0,0))
total_pnts.append(pnts)

a = th.list_to_tree(total_pnts, source=[0,0])

'''
import ghpythonlib.treehelpers as th
x = th.tree_to_list(x)
a = []
for i,branch in enumerate(x):
    for j,item in enumerate(branch):
        s = str(i) + "[" + str(j) + "] "
        s += type(item).__name__ + ": "
        s += str(item)
        a.append(s)
'''
# ---------- end python_3_script ----------
expression_4 = Expression(x=deconstruct_4.XComponent, y=deconstruct_4.YComponent, Expression="Format(\"{0} {1}\", round(x,3), round(y,3))")
expression_5 = Expression(x=deconstruct_5.XComponent, y=deconstruct_5.YComponent, Expression="Format(\"{0} {1}\", round(x,3), round(y,3))")
expression_6 = Expression(x=deconstruct_6.XComponent, y=deconstruct_6.YComponent, Expression="Format(\"{0} {1}\", round(x,3), round(y,3))")
python_3_script_2 = Python3Script(
    slab_outline_points=cull_duplicates_2.Points,
    slab_openings_points=cull_duplicates_3.Points,
    occupancy_a_points=cull_duplicates_4.Points,
    occupancy_b_points=cull_duplicates_5.Points,
    walls_points=cull_duplicates_6.Points,
    columns_points=cull_duplicates_7.Points)  # -> out, a; inputs slab_outline_points: list of Point3d, slab_openings_points: tree of Point3d, occupancy_a_points: list of Point3d, occupancy_b_points: list of Point3d, walls_points: tree of Point3d, columns_points: tree of Point3d
# ---------- python_3_script_2: Python ----------
import json
import ghpythonlib.treehelpers as th


slab_outline = [(pnt.X,pnt.Y) for pnt in slab_outline_points]

occupancy_a = [(pnt.X,pnt.Y) for pnt in occupancy_a_points]
occupancy_b = [(pnt.X,pnt.Y) for pnt in occupancy_b_points]

slab_openings_points = th.tree_to_list(slab_openings_points)
slab_openings = []
for i,tree in enumerate(slab_openings_points):
    for j,branch in enumerate(tree):
        slab_opening = []
        for k,item in enumerate(branch):
            slab_opening.append((item.X,item.Y))
        slab_openings.append(slab_opening)



walls_points = th.tree_to_list(walls_points)
walls = []
for i,tree in enumerate(walls_points):
    for j,branch in enumerate(tree):
        wall = []
        for k,item in enumerate(branch):
            wall.append((item.X,item.Y))
        walls.append(wall)


columns_points = th.tree_to_list(columns_points)
columns = []
for i,tree in enumerate(columns_points):
    for j,branch in enumerate(tree):
        column = []
        for k,item in enumerate(branch):
            column.append((item.X,item.Y))
        columns.append(column)

floor = {
    'slab_outline':slab_outline,
    'slab_openings':slab_openings,
    'occupancy_a':occupancy_a,
    'occupancy_b':occupancy_b,
    'walls':walls,
    'columns':columns
}

a = json.dumps(floor)

# with open('floor_data.json', 'w') as file:
#     json.dump(file)
# ---------- end python_3_script_2 ----------
panel_3 = Panel(polygon_2.polygon)
panel_4 = Panel(polygon_3.multipolygon)
text_join = TextJoin(Text=expression, Join=",")
text_join_2 = TextJoin(Text=expression_2, Join=",")
polyline = PolyLine(Vertices=python_3_script.a, Closed=False)
panel_5 = Panel(text_join)
panel_6 = Panel(text_join_2)
columns_4 = Panel(expression_3)
panel_7 = Panel(python_3_script_2.a)
slab_openings_4 = Panel(expression_5)
walls_4 = Panel(expression_4)
slab_edge_4 = Panel(expression_6)
text_join_3 = TextJoin(Text=expression_3, Join=",")
python_3_script_3 = Python3Script(multipolygon="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")  # -> out, pnts
# ---------- python_3_script_3: Python ----------
"""Grasshopper Script"""
import rhinoscriptsyntax as rs
import ghpythonlib.treehelpers as th
import shapely as shp
import shapely.wkt as wkt

multipolygon
geom_object = wkt.loads(multipolygon)

pnts = []
for polygon in geom_object.geoms:
    coords = polygon.exterior.coords
    pnt_list = [rs.AddPoint(coord[0],coord[1],0) for coord in coords]
    pnts.append(pnt_list)

pnts = th.list_to_tree(pnts, source=[0,0])


'''
import ghpythonlib.treehelpers as th
x = th.tree_to_list(x)
a = []
for i,branch in enumerate(x):
    for j,item in enumerate(branch):
        s = str(i) + "[" + str(j) + "] "
        s += type(item).__name__ + ": "
        s += str(item)
        a.append(s)
'''
# ---------- end python_3_script_3 ----------
text_join_4 = TextJoin(Text=expression_4, Join=",")
text_join_5 = TextJoin(Text=expression_5, Join=",")
panel_8 = Panel(text_join_3)
text_join_6 = TextJoin(Text=expression_6, Join=",")
panel_9 = Panel(text_join_4)
polyline_2 = PolyLine(Vertices=python_3_script_3.pnts, Closed=False)
panel_10 = Panel(text_join_5)
concatenate = Concatenate(Fragment_A="((", Fragment_B=text_join_5, Fragment_C="))")  # -> flatten(Result)
concatenate_2 = Concatenate(Fragment_A="((", Fragment_B=text_join_4, Fragment_C="))")  # -> flatten(Result)
concatenate_3 = Concatenate(Fragment_A="((", Fragment_B=text_join_3, Fragment_C="))")  # -> flatten(Result)
text_join_7 = TextJoin(Text=concatenate, Join=",")
text_join_8 = TextJoin(Text=concatenate_2, Join=",")
text_join_9 = TextJoin(Text=concatenate_3, Join=",")
panel_11 = Panel(text_join_6)
panel_12 = Panel(text_join_7)
panel_13 = Panel(text_join_8)
panel_14 = Panel(text_join_9)
